# Dynamo graph player_COLUMN.dyn (Dynamo 2.3.2.15696)

file_path = Filename("..\revit_obj_output.json")  # graph input
file_from_path = FileObject(path=file_path)
readText = FileSystem.ReadText(file=file_from_path)
levels = Levels("Level 1")  # graph input
elevation = Level.Elevation(level=levels)
levels_2 = Levels("Level 2")  # graph input
elevation_2 = Level.Elevation(level=levels_2)
python_script = Python(IN[0]=readText, IN[1]=elevation, IN[2]=elevation_2)
# ---------- python_script.python (56 lines) ----------
# Load the Python Standard and DesignScript Libraries
import sys
import clr
import json
clr.AddReference('ProtoGeometry')
from Autodesk.DesignScript.Geometry import *

# The inputs to this node will be stored as a list in the IN variables.
dataEnteringNode = IN
json_text_data = IN[0]
bottom_level = IN[1]
top_level = IN[2]
# Place your code below this line

json_data = json.loads(json_text_data)

#top_level = json_data['settings']['end_level']
#bottom_level = json_data['settings']['start_level']

start_point =[]
end_point=[]
cross_section_angle = []
family_type = []

cir_start_point =[]
cir_end_point=[]
cir_family_type = []

column_height = round(float(top_level) - float(bottom_level),2)

for col in json_data['columns']:
	x = float(col['center'][0])
	y = float(col['center'][1])
	z = float(bottom_level)
	#z = 0
	start_point.append(Point.ByCoordinates(x,y,z))
	z = float(top_level)
	#z = column_height
	end_point.append(Point.ByCoordinates(x,y,z))
	cross_section_angle.append( -1 * float(col['shape'][2]) + 90)
	family_type.append(col['shape'][3])


for col in json_data['columns_circle']:
	x = float(col['center'][0])
	y = float(col['center'][1])
	z = float(bottom_level)
	#z=0
	cir_start_point.append(Point.ByCoordinates(x,y,z))
	z = float(top_level)
	#z = column_height
	cir_end_point.append(Point.ByCoordinates(x,y,z))
	cir_family_type.append(col['shape'][1])

# Assign your output to the OUT variable.
OUT = start_point,end_point,cross_section_angle,family_type,cir_start_point,cir_end_point,cir_family_type
# ----------------------------------------
code_block = CodeBlock(out=python_script) { out; out[0]; out[1]; out[2]; out[3]; "circular"; out[4]; out[5]; out[6]; }
byStartPointEndPoint = Line.ByStartPointEndPoint(startPoint=code_block.out1, endPoint=code_block.out2, lacing=Shortest)
code_block_2 = CodeBlock { "Structural-Column_Rectangular_NA"; "Structural-Column_Round_NA"; }
byFamilyNameAndTypeName = FamilyType.ByFamilyNameAndTypeName(familyName=code_block_2.out0, typeName=code_block.out4)
# note: the level should be the lower
columnByCurve = StructuralFraming.ColumnByCurve(curve=byStartPointEndPoint, level=levels, structuralColumnType=byFamilyNameAndTypeName)  # graph output
code_block_3 = CodeBlock { "Cross-Section Rotation"; }
setParameterByName = Element.SetParameterByName(element=columnByCurve, parameterName=code_block_3, value=code_block.out3)
byStartPointEndPoint_2 = Line.ByStartPointEndPoint(startPoint=code_block.out6, endPoint=code_block.out7, lacing=Shortest)
byFamilyNameAndTypeName_2 = FamilyType.ByFamilyNameAndTypeName(familyName=code_block_2.out1, typeName=code_block.out8)
columnByCurve_2 = StructuralFraming.ColumnByCurve(curve=byStartPointEndPoint_2, level=levels, structuralColumnType=byFamilyNameAndTypeName_2)  # graph output
