# Dynamo graph player_WALL.dyn (Dynamo 2.3.2.15696)

levels = Levels("Level 2")  # graph input
elevation = Level.Elevation(level=levels)
file_path = Filename(".\221031_BASEMENT_revit_obj_output.json")  # graph input
file_from_path = FileObject(path=file_path)
readText = FileSystem.ReadText(file=file_from_path)
levels_2 = Levels("Level 1")  # graph input
elevation_2 = Level.Elevation(level=levels_2)
python_script = Python(IN[0]=readText, IN[1]=elevation_2)
# ---------- python_script.python (28 lines) ----------
# Load the Python Standard and DesignScript Libraries
import sys
import clr
import json
clr.AddReference('ProtoGeometry')
from Autodesk.DesignScript.Geometry import *
# The inputs to this node will be stored as a list in the IN variables.
dataEnteringNode = IN
json_text_data = IN[0]
level = IN[1]
# Place your code below this line
json_data = json.loads(json_text_data)
#top_level = json_data['settings']['end_level']
#bottom_level = json_data['settings']['start_level']
curve_points = []
wall_types = []
level=0
for wall in json_data['walls']:
	wall_types.append(wall['shape'][1])
	coordinates = []
	for po in wall['coordinates']:
		x = float(po[0])
		y = float(po[1])
		coordinates.append(Point.ByCoordinates(x,y,level))
	curve_points.append(coordinates)
		
# Assign your output to the OUT variable.
OUT = curve_points, wall_types
# ----------------------------------------
code_block = CodeBlock(out=python_script) { out; out[0]; out[1]; }
byPoints = PolyCurve.ByPoints(points=code_block.out1)
curves = PolyCurve.Curves(polyCurve=byPoints)
byName = WallType.ByName(name=code_block.out2)
byCurveAndLevels = Wall.ByCurveAndLevels(c=curves, startLevel=levels_2, endLevel=levels, wallType=byName)  # graph output
code_block_2 = CodeBlock { "Top Constraint"; "Structural"; }
parameterByName = Parameter.ParameterByName(element=byCurveAndLevels, name=code_block_2.out0)
python_script_2 = Python(IN[0]=parameterByName, IN[1]=levels)
# ---------- python_script_2.python (25 lines) ----------
# Load the Python Standard and DesignScript Libraries
import sys
import clr
clr.AddReference('ProtoGeometry')
from Autodesk.DesignScript.Geometry import *

# The inputs to this node will be stored as a list in the IN variables.
dataEnteringNode = IN
input_list = IN[0]
top_constrain = IN[1]
# Place your code below this line

out_list = []
structural = []
for x in input_list:
	inner_list = []
	structural_inner_list = []
	for y in x:
		inner_list.append(top_constrain)
		structural_inner_list.append(1)
	out_list.append(inner_list)
	structural.append(structural_inner_list)

# Assign your output to the OUT variable.
OUT = out_list, structural
# ----------------------------------------
code_block_3 = CodeBlock(output=python_script_2) { output; output[0]; output[1]; }
setValue = Parameter.SetValue(parameter=parameterByName, value=code_block_3.out1)
parameterByName_2 = Parameter.ParameterByName(element=byCurveAndLevels, name=code_block_2.out1)
setValue_2 = Parameter.SetValue(parameter=parameterByName_2, value=code_block_3.out2)
watch = Watch(code_block.out2)
