# Dynamo graph Revit_StructuralFloors.dyn (Dynamo 2.3.2.15696)

file_path = Filename("..\..\mytemp.txt")
file_from_path = FileObject(path=file_path)
readText = FileSystem.ReadText(file=file_from_path)
levels = Levels("GROUND FLR LEVEL")
elevation = Level.Elevation(level=levels)
python_script = Python(IN[0]=readText, IN[1]=elevation)
# ---------- python_script.python (27 lines) ----------
# Load the Python Standard and DesignScript Libraries
import sys
import clr
import json
clr.AddReference('ProtoGeometry')
from Autodesk.DesignScript.Geometry import *
# The inputs to this node will be stored as a list in the IN variables.
dataEnteringNode = IN
json_text_data = IN[0]
level = round(IN[1],3)
# Place your code below this line
json_data = json.loads(json_text_data)
#top_level = json_data['settings']['end_level']
#bottom_level = json_data['settings']['start_level']
curve_points = []
floor_types = []
for floor in json_data['floors']:
	floor_types.append(floor['shape'][1])
	coordinates = []
	for po in floor['coordinates']:
		x = float(po[0])
		y = float(po[1])
		coordinates.append(Point.ByCoordinates(x,y,level))
	curve_points.append(coordinates)
		
# Assign your output to the OUT variable.
OUT = curve_points, floor_types
# ----------------------------------------
code_block = CodeBlock(out=python_script) { out; out[0]; out[1]; true; }
byPoints = PolyCurve.ByPoints(points=code_block.out1, connectLastToFirst=code_block.out3)
floor_types = FloorTypes("T200")
byOutlineTypeAndLevel = Floor.ByOutlineTypeAndLevel(outline=byPoints, floorType=floor_types, level=levels)
code_block_2 = CodeBlock { "Structural"; "Height Offset From Level"; 0; 1; }
parameterByName = Parameter.ParameterByName(element=byOutlineTypeAndLevel, name=code_block_2.out0)
setValue = Parameter.SetValue(parameter=parameterByName, value=code_block_2.out3)
watch = Watch(byPoints)
watch_2 = Watch(code_block.out1)
parameterByName_2 = Parameter.ParameterByName(element=byOutlineTypeAndLevel, name=code_block_2.out1)
setValue_2 = Parameter.SetValue(parameter=parameterByName_2, value=code_block_2.out2)
