# Dynamo graph 221106_columns.dyn (Dynamo 2.3.2.15696)

file_path = Filename("C:\Users\mali\Desktop\_Py_Projects\cadexporterpy\sample_data\revit_obj_output.json")  # graph input
readText = FileSystem.ReadText(file=file_path)
python_script = Python(IN[0]=readText)  # graph output
# ---------- python_script.python (81 lines) ----------
# Load the Python Standard and DesignScript Libraries  
import sys  
import clr
import json
clr.AddReference('ProtoGeometry')  
from Autodesk.DesignScript.Geometry import *  
clr.AddReference('RevitNodes')  
import Revit  
clr.ImportExtensions(Revit.Elements)  
clr.ImportExtensions(Revit.GeometryConversion) 
clr.AddReference('DSCoreNodes')  
import DSCore 
clr.AddReference('Tessellation')  
import Tessellation 
clr.AddReference('DSOffice')  
import DSOffice 


# The inputs to this node will be stored as a list in the IN variables.  
dataEnteringNode = IN  
json_data = json.loads(IN[0])

# Place your code below this line  
def get_columns_labels(json_data):
    labels = []
    for k,v in json_data.items():
        if k.startswith('columns'):
            for column in v:
                shape = column['shape'][-1]
                labels.append(shape)
    if len(labels) > 0:
        return set(labels)

def get_circular_columns_labels(json_data):
    labels = []
    for k,v in json_data.items():
        if k.startswith('columns_circle'):
            for column in v:
                shape = column['shape'][-1]
                labels.append(shape)
    if len(labels) > 0:
        return set(labels)

def get_walls_labels(json_data):
    labels = []
    for k,v in json_data.items():
        if k.startswith('walls'):
            for wall in v:
                shape = wall['shape'][1]
                labels.append(shape)
    if len(labels) > 0:
        return set(labels)



def get_floors_labels(json_data):
    labels = []
    for k,v in json_data.items():
        if k.startswith('floors'):
            for floor in v:
                shape = floor['shape'][1]
                labels.append(shape)
    if len(labels) > 0:
        return set(labels)

try:  
	errorReport = None  
	columns_labels = get_columns_labels(json_data)
	circular_columns_labels = get_circular_columns_labels(json_data)
	rectangular_columns_labels = columns_labels-circular_columns_labels
	walls_labels = get_walls_labels(json_data)
	floors_labels = get_floors_labels(json_data)
except:  
    import traceback  
    errorReport = traceback.format_exc()  
# Assign your output to the OUT variable.  
if errorReport is None:  
    #OUT = columns_labels,walls_labels,floors_labels
    OUT = rectangular_columns_labels,circular_columns_labels,walls_labels,floors_labels
else:  
    OUT = errorReport
# ----------------------------------------
levels = Levels("Level 1")  # graph input
levels_2 = Levels("Level 2")  # graph input
python_script_2 = Python(IN[0]=readText, IN[1]=levels, IN[2]=levels_2)  # graph output
# ---------- python_script_2.python (129 lines) ----------
# Load the Python Standard and DesignScript Libraries  
import sys  
import clr
import json
clr.AddReference('ProtoGeometry')  
from Autodesk.DesignScript.Geometry import *  
clr.AddReference('RevitNodes')  
import Revit  
clr.ImportExtensions(Revit.Elements)  
clr.ImportExtensions(Revit.GeometryConversion) 
clr.AddReference('DSCoreNodes')  
import DSCore 
clr.AddReference('Tessellation')  
import Tessellation 
clr.AddReference('DSOffice')  
import DSOffice 

import System 
from System import Array 
from System.Collections.Generic import * 
# The inputs to this node will be stored as a list in the IN variables.  
dataEnteringNode = IN  
json_data = json.loads(IN[0])
start_level = IN[1]
end_level = IN[2]
# Place your code below this line  

start_elevation = start_level.Elevation
end_elevation = end_level.Elevation
col_height = round(end_elevation - start_elevation,3)

result = []

try:  
	errorReport = None  
	for col in json_data['columns']:
		x,y = col['center']
		label = col['shape'][-1]
		angle = -1 * float(col['shape'][-2]) + 90
		pt1 = Point.ByCoordinates(x,y,start_elevation)
		pt2 = Point.ByCoordinates(x,y,end_elevation)
		line = Line.ByStartPointEndPoint(pt1,pt2)
		
		type = Revit.Elements.FamilyType.ByName(label)
		struc_column = Revit.Elements.StructuralFraming.ColumnByCurve(line,start_level,type)
		
		angle_parameter = Revit.Elements.Parameter.ParameterByName(struc_column,'Cross-Section Rotation')
		_ = Revit.Elements.Parameter.SetValue(angle_parameter,angle)
		result.append(struc_column)

	for col in json_data['columns_circle']:
		x,y = col['center']
		label = col['shape'][-1]
		
		pt1 = Point.ByCoordinates(x,y,start_elevation)
		pt2 = Point.ByCoordinates(x,y,end_elevation)
		line = Line.ByStartPointEndPoint(pt1,pt2)
		
		type = Revit.Elements.FamilyType.ByName(label)
		struc_column = Revit.Elements.StructuralFraming.ColumnByCurve(line,start_level,type)
		
		result.append(struc_column)
		
	for wall in json_data['walls']:
		label = wall['shape'][1]
		curve_points = []
		for pnt in wall['coordinates']:
			x,y = pnt
			curve_points.append(Point.ByCoordinates(x,y,0))
		if len(curve_points) < 1:
			continue
		poly_curve = PolyCurve.ByPoints(curve_points)
		curves = PolyCurve.Curves(poly_curve)
		if len(curves)<1:
			continue
		type = Revit.Elements.WallType.ByName(label)
		for curve in curves:
			struc_wall = Revit.Elements.Wall.ByCurveAndLevels(curve,start_level,end_level,type)
			structural_parameter = Revit.Elements.Parameter.ParameterByName(struc_wall,'Structural')
			_ = Revit.Elements.Parameter.SetValue(structural_parameter,1)
			top_constraint_parameter = Revit.Elements.Parameter.ParameterByName(struc_wall,'Top Constraint')
			_ = Revit.Elements.Parameter.SetValue(top_constraint_parameter,end_level)
			result.append(struc_wall)
			
	for wall in json_data['walls_arc']:
		label = wall['shape'][1]
		center_pnt = wall['coordinates'][0]
		start_pnt = wall['coordinates'][1]
		end_pnt = wall['coordinates'][2]
		type = Revit.Elements.WallType.ByName(label)
		z = 0
		curve = Arc.ByCenterPointStartPointEndPoint(Point.ByCoordinates(center_pnt[0],center_pnt[1],z),Point.ByCoordinates(start_pnt[0],start_pnt[1],z),Point.ByCoordinates(end_pnt[0],end_pnt[1],z))

		struc_wall = Revit.Elements.Wall.ByCurveAndLevels(curve,start_level,end_level,type)
		structural_parameter = Revit.Elements.Parameter.ParameterByName(struc_wall,'Structural')
		_ = Revit.Elements.Parameter.SetValue(structural_parameter,1)
		top_constraint_parameter = Revit.Elements.Parameter.ParameterByName(struc_wall,'Top Constraint')
		_ = Revit.Elements.Parameter.SetValue(top_constraint_parameter,end_level)
		result.append(struc_wall)
		

	for floor in json_data['floors']:
		label = floor['shape'][1]
		curve_points = []
		for pnt in floor['coordinates']:
			x,y = pnt
			curve_points.append(Point.ByCoordinates(x,y,end_elevation))
		if len(curve_points) < 1:
			continue
		poly_curve = PolyCurve.ByPoints(curve_points, True)

		type = Revit.Elements.FloorType.ByName(label)

		struc_floor = Revit.Elements.Floor.ByOutlineTypeAndLevel(poly_curve,type, end_level)
		
		structural_parameter = Revit.Elements.Parameter.ParameterByName(struc_floor,'Structural')
		_ = Revit.Elements.Parameter.SetValue(structural_parameter,1)
		result.append(struc_floor)
		


except:  
    import traceback  
    errorReport = traceback.format_exc()  
# Assign your output to the OUT variable.  
if errorReport is None:  
    OUT = result
else:  
    OUT = errorReport
# ----------------------------------------
